# Grasshopper definition ifcParser.gh (Grasshopper 0.9.76)
# plug-ins: Python Interpreter

raw_ifc = Panel("""#98= IFCCARTESIANPOINT((-3.,13.,0.));
#102= IFCCARTESIANPOINT((12.,10.,0.));
#106= IFCCARTESIANPOINT((15.,13.,0.));
#111= IFCCARTESIANPOINT((0.,10.,0.));
#115= IFCCARTESIANPOINT((12.,10.,-1.));
#119= IFCCARTESIANPOINT((15.,13.,-1.));
#123= IFCCARTESIANPOINT((-3.,13.,-1.));
#127= IFCCARTESIANPOINT((0.,10.,-1.));
#131= IFCPOLYLOOP((#98,#102,#106));
#135= IFCFACEOUTERBOUND(#131,.T.);
#138= IFCFACE((#135));
#142= IFCPOLYLOOP((#102,#98,#111));
#146= IFCFACEOUTERBOUND(#142,.T.);
#149= IFCFACE((#146));
#153= IFCPOLYLOOP((#106,#102,#115,#119));
#157= IFCFACEOUTERBOUND(#153,.T.);
#160= IFCFACE((#157));
#164= IFCPOLYLOOP((#98,#106,#119,#123));
#168= IFCFACEOUTERBOUND(#164,.T.);
#171= IFCFACE((#168));
#175= IFCPOLYLOOP((#111,#98,#123,#127));
#179= IFCFACEOUTERBOUND(#175,.T.);
#182= IFCFACE((#179));
#186= IFCPOLYLOOP((#102,#111,#127,#115));
#190= IFCFACEOUTERBOUND(#186,.T.);
#193= IFCFACE((#190));
#197= IFCPOLYLOOP((#123,#119,#115,#127));
#201= IFCFACEOUTERBOUND(#197,.T.);
#204= IFCFACE((#201));
#208= IFCCLOSEDSHELL((#138,#149,#160,#171,#182,#193,#204));
#212= IFCFACETEDBREP(#208);
#215= IFCCOLOURRGB('colour',0.57254902,0.50196078,0.45490196);
#216= IFCSURFACESTYLERENDERING(#215,0.,IFCNORMALISEDRATIOMEASURE(1.),$,$,$,IFCNORMALISEDRATIOMEASURE(0.),$,.NOTDEFINED.);
#217= IFCSURFACESTYLE('Erde',.BOTH.,(#216));
#219= IFCPRESENTATIONSTYLEASSIGNMENT((#217));
#264= IFCCOMPOSITECURVE((#260),.U.);
#268= IFCGEOMETRICSET((#738,#587,#436,#264));
#271= IFCDIRECTION((6.1230318E-17,1.));
#279= IFCSHAPEREPRESENTATION(#275,'FootPrint','GeometricSet',(#268));
#286= IFCCARTESIANPOINT((12.,0.,0.));
#290= IFCCARTESIANPOINT((15.,13.,0.));
#294= IFCCARTESIANPOINT((12.,10.,0.));
#298= IFCCARTESIANPOINT((15.,-3.,0.));
#302= IFCCARTESIANPOINT((15.,13.,-1.));
#306= IFCCARTESIANPOINT((12.,10.,-1.));
#310= IFCCARTESIANPOINT((12.,0.,-1.));
#314= IFCCARTESIANPOINT((15.,-3.,-1.));
#318= IFCPOLYLOOP((#286,#290,#294));
#322= IFCFACEOUTERBOUND(#318,.T.);
#325= IFCFACE((#322));
#329= IFCPOLYLOOP((#290,#286,#298));
#333= IFCFACEOUTERBOUND(#329,.T.);
#336= IFCFACE((#333));
#340= IFCPOLYLOOP((#294,#290,#302,#306));
#344= IFCFACEOUTERBOUND(#340,.T.);
#347= IFCFACE((#344));
#351= IFCPOLYLOOP((#286,#294,#306,#310));
#355= IFCFACEOUTERBOUND(#351,.T.);
#358= IFCFACE((#355));
#362= IFCPOLYLOOP((#298,#286,#310,#314));
#367= IFCFACEOUTERBOUND(#362,.T.);
#370= IFCFACE((#367));
#374= IFCPOLYLOOP((#290,#298,#314,#302));
#378= IFCFACEOUTERBOUND(#374,.T.);
#381= IFCFACE((#378));
#385= IFCPOLYLOOP((#302,#314,#310,#306));
#389= IFCFACEOUTERBOUND(#385,.T.);
#392= IFCFACE((#389));
#396= IFCCLOSEDSHELL((#325,#336,#347,#358,#370,#381,#392));
#400= IFCFACETEDBREP(#396);
#403= IFCSURFACESTYLE('Erde',.BOTH.,(#216));
#405= IFCPRESENTATIONSTYLEASSIGNMENT((#403));""")
raw_ifc_2 = Panel("""ISO-10303-21;

http://www.buildingsmart-tech.org/ifc/IFC2x3/TC1/html/index.htm


HEADER;
FILE_DESCRIPTION(('ArchiCAD 11.00 Release 1 generated IFC file.','Build Number of the Ifc 2x3 interface: 63090 (13-06-2008)\X\0A'),'2;1');
FILE_NAME('S:\\[IFC]\\COMPLETE-BUILDINGS\\FZK-MODELS\\FZK-Haus\\ArchiCAD-11\\IFC2x3\\AC11-FZK-Haus-IFC.ifc','2008-07-01T10:47:10',('Architect'),('Building Designer Office'),'PreProc - EDM 4.5.0033','Windows System','The authorising person');
FILE_SCHEMA(('IFC2X3'));
ENDSEC;

[] = array
$ = undefined
* = undefined
[1:?] = an unbounded array length
[1:3] = a bounded array length


DATA;
#1= IFCORGANIZATION('GS','Graphisoft','Graphisoft',$,$,$,$,$);
#5= IFCAPPLICATION(#1,'11.0','ArchiCAD 11.0','ArchiCAD',$,$);
#6= IFCPOSTALADDRESS(.HOME.,'Home Address','private','Germany',$,'3640','Karlsruhe','Baden-Wuerttemberg','76021','Germany',$,$,$,$);
#9= IFCPOSTALADDRESS(.OFFICE.,'Office Telecom Address','official','Building 445',$,$,'Eggenstein-Leopoldshafen ','B.-W.','76344','Germany',$,$,$,$);
#12= IFCPOSTALADDRESS(.OFFICE.,'Office Postal Address','official','Germany',$,'3640','Karlsruhe','Baden-Wuerttemberg','76021','Germany',$,$,$,$);
#15= IFCPERSON('007','Haefele','Karl-Heinz',$,$,$,$,(#6,#9,#12),$,$);
#18= IFCACTORROLE(.ARCHITECT.,'','Hobby Architect',$);
#19= IFCPOSTALADDRESS(.OFFICE.,'','','Germany',$,$,'Karlsruhe',$,$,$,$,$,$,$);
#22= IFCORGANIZATION('','Karl-Heinz Haefele','Forschungszentrum Karlsruhe',(#18),(#19),$,$,$);
#28= IFCPERSONANDORGANIZATION(#15,#22,$);


* Direct reference to the end user who currently "owns" this object. *
#29= IFCOWNERHISTORY(#28 = IFCPERSONANDORGANIZATION(#15 = IFCPERSON('007','Haefele','Karl-Heinz',$,$,$,$,(#6 = IFCPOSTALADDRESS(.HOME.,'Home Address','private','Germany',$,'3640','Karlsruhe','Baden-Wuerttemberg','76021','Germany',$,$,$,$);,#9 = IFCPOSTALADDRESS(.OFFICE.,'Office Telecom Address','official','Building 445',$,$,'Eggenstein-Leopoldshafen ','B.-W.','76344','Germany',$,$,$,$);,#12 = IFCPOSTALADDRESS(.OFFICE.,'Office Postal Address','official','Germany',$,'3640','Karlsruhe','Baden-Wuerttemberg','76021','Germany',$,$,$,$);),$,$);,#22 = IFCORGANIZATION('','Karl-Heinz Haefele','Forschungszentrum Karlsruhe',(#18 = IFCACTORROLE(.ARCHITECT.,'','Hobby Architect',$);),(#19 = IFCPOSTALADDRESS(.OFFICE.,'','','Germany',$,$,'Karlsruhe',$,$,$,$,$,$,$);),$,$,$);,$);,#5 = IFCAPPLICATION(#1 = IFCORGANIZATION('GS','Graphisoft','Graphisoft',$,$,$,$,$);,'11.0','ArchiCAD 11.0','ArchiCAD',$,$);,  OPTIONAL IfcStateEnum , ChangeAction .NOCHANGE.,OPTIONAL LastModifiedDate,OPTIONAL LastModifyingUser,OPTIONAL LastModifyingApplication,CreationDate 1214902009);

* converts radians into degrees requires a name for the new unit, a reference of a related unit and factor *
#36= IFCCONVERSIONBASEDUNIT(#35 = IFCDIMENSIONALEXPONENTS(0,0,0,0,0,0,0),.PLANEANGLEUNIT.,'DEGREE',#34= IFCMEASUREWITHUNIT(IFCPLANEANGLEMEASURE(0.017453292519943 (real)= radians per degree),#33 = IFCSIUNIT(*,.PLANEANGLEUNIT.,$,.RADIAN.,$,$););,$);

* defines a scientific unit of measurement
#40= IFCSIUNIT('IfcDimensionalExponents',.IFCUNITENUM.,$'OPTIONAL PREFIX',.IFCSIUNITNAME.);  e.g #41= IFCSIUNIT(*,.TIMEUNIT.,$,.SECOND.);



#42= IFCUNITASSIGNMENT((#30,#31,#32,#36,#37,#38,#39,#40,#41),$);

* defines a vector *
#44= IFCDIRECTION((1.,0.,0.),$,$,$);
#48= IFCDIRECTION((0.,1.,0.));
#52= IFCDIRECTION((0.,0.,1.));

* defines a location point
#56= IFCCARTESIANPOINT((0.,0.,0.));

* places a plane at location with z-normal defined  as vector 
#59= IFCAXIS1PLACEMENT3D(#56,#52);
* places a plane at location with two defined vectors 
#60= IFCAXIS2PLACEMENT3D(#56,#52,#44);
* places a plane at location with two defined vectors 
#61= IFCAXIS2PLACEMENT2D(POSITION #56,OPTIONAL_REFERENCE_DIRECTION, X_VECTOR #52, Y_VECTOR #44);

#63= IFCDIRECTION((6.1230318E-17,1.)); *True North*

#67= IFCGEOMETRICREPRESENTATIONCONTEXT(ContextIdentifier:'Plan',ContextType:'Design',CoordinateSpaceDimension: 3, Precision: 1.0000000E-5, coordinateSystem: #60 = IFCAXIS2PLACEMENT3D(#56,#52,#44);, trueNorth: #63);

#70= IFCPROJECT('0lY6P5Ur90TAQnnnI6wtnb',#29,'Projekt-FZK-Haus','Projekt FZK-House create by KHH Forschuungszentrum Karlsruhe',$,$,$,(#67,#229,#275),#42);
#77= IFCPROPERTYSET('23c60cQ8z6HuG8CauVG86C',#29,'Pset_ProjectCommon',$,(#83,#88,#93));
#81= IFCRELDEFINESBYPROPERTIES('0h0gYseYT5fgmlHad9GDAw',#29,$,$,(#70),#77);
#83= IFCPROPERTYSINGLEVALUE('ConstructionMode',$,IFCLABEL('Massivhaus'),$);
#88= IFCPROPERTYSINGLEVALUE('BuildingPermitId',$,IFCIDENTIFIER('1234'),$);
#93= IFCPROPERTYSINGLEVALUE('GrossAreaPlanned','Description',IFCAREAMEASURE(288.),'unit');
#98= IFCCARTESIANPOINT((-3.,13.,0.));
#102= IFCCARTESIANPOINT((12.,10.,0.));
#106= IFCCARTESIANPOINT((15.,13.,0.));
#111= IFCCARTESIANPOINT((0.,10.,0.));
#115= IFCCARTESIANPOINT((12.,10.,-1.));
#119= IFCCARTESIANPOINT((15.,13.,-1.));
#123= IFCCARTESIANPOINT((-3.,13.,-1.));
#127= IFCCARTESIANPOINT((0.,10.,-1.));
#131= IFCPOLYLOOP((#98,#102,#106));
#135= IFCFACEOUTERBOUND(#131,.T.);
#138= IFCFACE((#135));
#142= IFCPOLYLOOP((#102,#98,#111));
#146= IFCFACEOUTERBOUND(#142,.T.);
#149= IFCFACE((#146));
#153= IFCPOLYLOOP((#106,#102,#115,#119));
#157= IFCFACEOUTERBOUND(#153,.T.);
#160= IFCFACE((#157));
#164= IFCPOLYLOOP((#98,#106,#119,#123));
#168= IFCFACEOUTERBOUND(#164,.T.);
#171= IFCFACE((#168));
#175= IFCPOLYLOOP((#111,#98,#123,#127));
#179= IFCFACEOUTERBOUND(#175,.T.);
#182= IFCFACE((#179));
#186= IFCPOLYLOOP((#102,#111,#127,#115));
#190= IFCFACEOUTERBOUND(#186,.T.);
#193= IFCFACE((#190));
#197= IFCPOLYLOOP((#123,#119,#115,#127));
#201= IFCFACEOUTERBOUND(#197,.T.);
#204= IFCFACE((#201));
#208= IFCCLOSEDSHELL((#138,#149,#160,#171,#182,#193,#204));
#212= IFCFACETEDBREP(#208);
#215= IFCCOLOURRGB($,0.57254902,0.50196078,0.45490196);
#216= IFCSURFACESTYLERENDERING(#215,0.,IFCNORMALISEDRATIOMEASURE(1.),$,$,$,IFCNORMALISEDRATIOMEASURE(0.),$,.NOTDEFINED.);
#217= IFCSURFACESTYLE('Erde',.BOTH.,(#216));
#219= IFCPRESENTATIONSTYLEASSIGNMENT((#217));
#221= IFCSTYLEDITEM(#212,(#219),$);
#225= IFCDIRECTION((6.1230318E-17,1.));
#229= IFCGEOMETRICREPRESENTATIONCONTEXT('Plan','Model',3,1.0000000E-5,#60,#225);
#233= IFCSHAPEREPRESENTATION(#229,'Body','Brep',(#702,#551,#400,#212));
#240= IFCCARTESIANPOINT((0.,10.));
#244= IFCCARTESIANPOINT((-3.,13.));
#248= IFCCARTESIANPOINT((15.,13.));
#252= IFCCARTESIANPOINT((12.,10.));
#256= IFCPOLYLINE((#240,#244,#248,#252,#240));
#260= IFCCOMPOSITECURVESEGMENT(.CONTINUOUS.,..,#256);
#264= IFCCOMPOSITECURVE((#260),.U.);
#268= IFCGEOMETRICSET((#738,#587,#436,#264));
#271= IFCDIRECTION((6.1230318E-17,1.));
#275= IFCGEOMETRICREPRESENTATIONCONTEXT('Plan','Plan',3,1.0000000E-5,#60,#271);
#279= IFCSHAPEREPRESENTATION(#275,'FootPrint','GeometricSet',(#268));
#286= IFCCARTESIANPOINT((12.,0.,0.));
#290= IFCCARTESIANPOINT((15.,13.,0.));
#294= IFCCARTESIANPOINT((12.,10.,0.));
#298= IFCCARTESIANPOINT((15.,-3.,0.));
#302= IFCCARTESIANPOINT((15.,13.,-1.));
#306= IFCCARTESIANPOINT((12.,10.,-1.));
#310= IFCCARTESIANPOINT((12.,0.,-1.));
#314= IFCCARTESIANPOINT((15.,-3.,-1.));
#318= IFCPOLYLOOP((#286,#290,#294));
#322= IFCFACEOUTERBOUND(#318,.T.);
#325= IFCFACE((#322));
#329= IFCPOLYLOOP((#290,#286,#298));
#333= IFCFACEOUTERBOUND(#329,.T.);
#336= IFCFACE((#333));
#340= IFCPOLYLOOP((#294,#290,#302,#306));
#344= IFCFACEOUTERBOUND(#340,.T.);
#347= IFCFACE((#344));
#351= IFCPOLYLOOP((#286,#294,#306,#310));
#355= IFCFACEOUTERBOUND(#351,.T.);
#358= IFCFACE((#355));
#362= IFCPOLYLOOP((#298,#286,#310,#314));
#367= IFCFACEOUTERBOUND(#362,.T.);
#370= IFCFACE((#367));
#374= IFCPOLYLOOP((#290,#298,#314,#302));
#378= IFCFACEOUTERBOUND(#374,.T.);
#381= IFCFACE((#378));
#385= IFCPOLYLOOP((#302,#314,#310,#306));
#389= IFCFACEOUTERBOUND(#385,.T.);
#392= IFCFACE((#389));
#396= IFCCLOSEDSHELL((#325,#336,#347,#358,#370,#381,#392));
#400= IFCFACETEDBREP(#396);
#403= IFCSURFACESTYLE('Erde',.BOTH.,(#216));
#405= IFCPRESENTATIONSTYLEASSIGNMENT((#403));
#407= IFCSTYLEDITEM(#400,(#405),$);
#412= IFCCARTESIANPOINT((12.,10.));
#416= IFCCARTESIANPOINT((12.,0.));
#420= IFCCARTESIANPOINT((15.,-3.));
#424= IFCCARTESIANPOINT((15.,13.));
#428= IFCPOLYLINE((#412,#416,#420,#424,#412));
#432= IFCCOMPOSITECURVESEGMENT(.CONTINUOUS.,.F.,#428);
#436= IFCCOMPOSITECURVE((#432),.U.);
#441= IFCCARTESIANPOINT((15.,-3.,0.));
#445= IFCCARTESIANPOINT((12.,0.,0.));
#449= IFCCARTESIANPOINT((-3.,-3.,0.));
#453= IFCCARTESIANPOINT((15.,-3.,-1.));
#457= IFCCARTESIANPOINT((12.,0.,-1.));
#461= IFCCARTESIANPOINT((6.6613381E-16,0.,-1.));
#465= IFCCARTESIANPOINT((-3.,-3.,-1.));
#469= IFCPOLYLOOP((#56,#441,#445));
#473= IFCFACEOUTERBOUND(#469,.T.);
#476= IFCFACE((#473));
#480= IFCPOLYLOOP((#449,#441,#56));
#484= IFCFACEOUTERBOUND(#480,.T.);
#487= IFCFACE((#484));
#491= IFCPOLYLOOP((#445,#441,#453,#457));
#496= IFCFACEOUTERBOUND(#491,.T.);
#499= IFCFACE((#496));
#503= IFCPOLYLOOP((#56,#445,#457,#461));
#507= IFCFACEOUTERBOUND(#503,.T.);
#510= IFCFACE((#507));
#514= IFCPOLYLOOP((#441,#449,#465,#453));
#518= IFCFACEOUTERBOUND(#514,.T.);
#521= IFCFACE((#518));
#525= IFCPOLYLOOP((#449,#56,#461,#465));
#529= IFCFACEOUTERBOUND(#525,.T.);
#532= IFCFACE((#529));
#536= IFCPOLYLOOP((#465,#461,#457,#453));
#540= IFCFACEOUTERBOUND(#536,.T.);
#543= IFCFACE((#540));
#547= IFCCLOSEDSHELL((#476,#487,#499,#510,#521,#532,#543));
#551= IFCFACETEDBREP(#547);
#554= IFCSURFACESTYLE('Erde',.BOTH.,(#216));
#556= IFCPRESENTATIONSTYLEASSIGNMENT((#554));
#558= IFCSTYLEDITEM(#551,(#556),$);
#563= IFCCARTESIANPOINT((-3.,-3.));
#567= IFCCARTESIANPOINT((6.6613381E-16,0.));
#571= IFCCARTESIANPOINT((12.,0.));
#575= IFCCARTESIANPOINT((15.,-3.));
#579= IFCPOLYLINE((#563,#567,#571,#575,#563));
#583= IFCCOMPOSITECURVESEGMENT(.CONTINUOUS.,.F.,#579);
#587= IFCCOMPOSITECURVE((#583),.U.);
#592= IFCCARTESIANPOINT((0.,10.,0.));
#596= IFCCARTESIANPOINT((-3.,-3.,0.));
#600= IFCCARTESIANPOINT((6.6613381E-16,0.,-1.));
#604= IFCCARTESIANPOINT((0.,10.,-1.));
#608= IFCCARTESIANPOINT((-3.,13.,0.));
#612= IFCCARTESIANPOINT((-3.,-3.,-1.));
#616= IFCCARTESIANPOINT((-3.,13.,-1.));
#620= IFCPOLYLOOP((#56,#592,#596));
#625= IFCFACEOUTERBOUND(#620,.T.);
#628= IFCFACE((#625));
#632= IFCPOLYLOOP((#592,#56,#600,#604));
#636= IFCFACEOUTERBOUND(#632,.T.);
#639= IFCFACE((#636));
#643= IFCPOLYLOOP((#608,#596,#592));
#647= IFCFACEOUTERBOUND(#643,.T.);
#650= IFCFACE((#647));
#654= IFCPOLYLOOP((#56,#596,#612,#600));
#658= IFCFACEOUTERBOUND(#654,.T.);
#661= IFCFACE((#658));
#665= IFCPOLYLOOP((#600,#612,#616,#604));
#669= IFCFACEOUTERBOUND(#665,.T.);
#672= IFCFACE((#669));
#676= IFCPOLYLOOP((#608,#592,#604,#616));
#680= IFCFACEOUTERBOUND(#676,.T.);
#683= IFCFACE((#680));
#687= IFCPOLYLOOP((#596,#608,#616,#612));
#691= IFCFACEOUTERBOUND(#687,.T.);
#694= IFCFACE((#691));
#698= IFCCLOSEDSHELL((#628,#639,#650,#661,#672,#683,#694));
#702= IFCFACETEDBREP(#698);
#705= IFCSURFACESTYLE('Erde',.BOTH.,(#216));
#707= IFCPRESENTATIONSTYLEASSIGNMENT((#705));
#709= IFCSTYLEDITEM(#702,(#707),$);
#714= IFCCARTESIANPOINT((-3.,-3.));
#718= IFCCARTESIANPOINT((-3.,13.));
#722= IFCCARTESIANPOINT((0.,10.));
#726= IFCCARTESIANPOINT((6.6613381E-16,0.));
#730= IFCPOLYLINE((#714,#718,#722,#726,#714));
#734= IFCCOMPOSITECURVESEGMENT(.CONTINUOUS.,.F.,#730);
#738= IFCCOMPOSITECURVE((#734),.U.);
#743= IFCPRODUCTDEFINITIONSHAPE($,'Site',(#233,#279));
#747= IFCLOCALPLACEMENT($,#60);
#751= IFCSITE('0KMpiAlnb52RgQuM1CwVfd',#29,'Gelaende','Ebenes Gelaende','LandUse',#747,#743,$,.ELEMENT.,(52,31,0),(13,24,0),$,$,$);
#761= IFCLOCALPLACEMENT(#747,#60);
#764= IFCBUILDING('2hQBAVPOr5VxhS3Jl0O47h',#29,'FZK-Haus','FZK-Haus create by KHH / IAI / FZK','Wohnhaus',#761,$,$,.ELEMENT.,$,$,$);
#774= IFCAXIS2PLACEMENT3D(#56,#52,#44);
#777= IFCLOCALPLACEMENT(#761,#774);
#780= IFCBUILDINGSTOREY('3XCneI9iz229MqbsDmyZvc',#29,'Erdgeschoss',$,$,#777,$,$,.ELEMENT.,0.);
#790= IFCMATERIAL('Leichtbeton');
#793= IFCGEOMETRICREPRESENTATIONSUBCONTEXT('Annotation2D','Plan',*,*,*,*,#275,0.01,.PLAN_VIEW.,$);
#796= IFCCOLOURRGB($,0.,0.,0.);
#797= IFCCURVESTYLEFONT('',(#799));
#799= IFCCURVESTYLEFONTPATTERN(650.,5350.);
#800= IFCCURVESTYLE($,#797,$,$);
#801= IFCPRESENTATIONSTYLEASSIGNMENT((#800));
#803= IFCCURVESTYLE('1',#797,$,#796);
#804= IFCCARTESIANPOINT((0.,0.));
#808= IFCFILLAREASTYLEHATCHING(#803,IFCPOSITIVELENGTHMEASURE(0.77942286),$,#804,0.);
#811= IFCCOLOURRGB($,0.,0.,0.);
#812= IFCCURVESTYLEFONT('',(#814));
#814= IFCCURVESTYLEFONTPATTERN(650.,5350.);
#815= IFCCURVESTYLE($,#812,$,$);
#816= IFCPRESENTATIONSTYLEASSIGNMENT((#815));
#818= IFCCURVESTYLE('2',#812,$,#811);
#819= IFCCARTESIANPOINT((0.225,0.38971142));
#823= IFCFILLAREASTYLEHATCHING(#818,IFCPOSITIVELENGTHMEASURE(0.77942286),$,#819,0.);
#826= IFCCOLOURRGB($,0.,0.,0.);
#827= IFCCURVESTYLEFONT('',(#829));
#829= IFCCURVESTYLEFONTPATTERN(650.,5350.);
#830= IFCCURVESTYLE($,#827,$,$);
#831= IFCPRESENTATIONSTYLEASSIGNMENT((#830));
#833= IFCCURVESTYLE('3',#827,$,#826);
#834= IFCCARTESIANPOINT((0.,0.));
#838= IFCFILLAREASTYLEHATCHING(#833,IFCPOSITIVELENGTHMEASURE(0.77942286),$,#834,60.);
#841= IFCCOLOURRGB($,0.,0.,0.);
#842= IFCCURVESTYLEFONT('',(#844));
#844= IFCCURVESTYLEFONTPATTERN(650.,5350.);
#845= IFCCURVESTYLE($,#842,$,$);
#846= IFCPRESENTATIONSTYLEASSIGNMENT((#845));
#848= IFCCURVESTYLE('4',#842,$,#841);
#849= IFCCARTESIANPOINT((1.35,0.));
#853= IFCFILLAREASTYLEHATCHING(#848,IFCPOSITIVELENGTHMEASURE(0.77942286),$,#849,60.);
#856= IFCCOLOURRGB($,0.,0.,0.);
#857= IFCCURVESTYLEFONT('',(#859));
#859= IFCCURVESTYLEFONTPATTERN(650.,5350.);
#860= IFCCURVESTYLE($,#857,$,$);
#861= IFCPRESENTATIONSTYLEASSIGNMENT((#860));
#863= IFCCURVESTYLE('5',#857,$,#856);
#864= IFCCARTESIANPOINT((-0.048749998,0.));
#868= IFCFILLAREASTYLEHATCHING(#863,IFCPOSITIVELENGTHMEASURE(0.77942286),$,#864,120.);
#871= IFCCOLOURRGB($,0.,0.,0.);
#872= IFCCURVESTYLEFONT('',(#874));
#874= IFCCURVESTYLEFONTPATTERN(650.,5350.);
#875= IFCCURVESTYLE($,#872,$,$);
#876= IFCPRESENTATIONSTYLEASSIGNMENT((#875));
#879= IFCCURVESTYLE('6',#872,$,#871);
#880= IFCCARTESIANPOINT((-0.49875001,0.));
#884= IFCFILLAREASTYLEHATCHING(#879,IFCPOSITIVELENGTHMEASURE(0.77942286),$,#880,120.);
#887= IFCCOLOURRGB($,0.,0.,0.);
#888= IFCCURVESTYLEFONT('',(#890,#891));
#890= IFCCURVESTYLEFONTPATTERN(0.,2000.);
#891= IFCCURVESTYLEFONTPATTERN(0.,3000.);
#892= IFCCURVESTYLE($,#888,$,$);
#893= IFCPRESENTATIONSTYLEASSIGNMENT((#892));
#895= IFCCURVESTYLE('7',#888,$,#887);
#896= IFCCARTESIANPOINT((0.,0.075));
#900= IFCFILLAREASTYLEHATCHING(#895,IFCPOSITIVELENGTHMEASURE(0.15),$,#896,0.);
#903= IFCCOLOURRGB($,0.,0.,0.);
#904= IFCCURVESTYLEFONT('',(#906,#907));
#906= IFCCURVESTYLEFONTPATTERN(0.,1500.);
#907= IFCCURVESTYLEFONTPATTERN(0.,2500.);
#908= IFCCURVESTYLE($,#904,$,$);
#909= IFCPRESENTATIONSTYLEASSIGNMENT((#908));
#911= IFCCURVESTYLE('8',#904,$,#903);
#912= IFCCARTESIANPOINT((0.18106602,0.10606602));
#916= IFCFILLAREASTYLEHATCHING(#911,IFCPOSITIVELENGTHMEASURE(0.15),$,#912,45.);
#919= IFCFILLAREASTYLE($,(#808,#823,#838,#853,#868,#884,#900,#916));
#921= IFCPRESENTATIONSTYLEASSIGNMENT((#919));
#923= IFCSTYLEDITEM($,(#921),$);
#927= IFCSTYLEDREPRESENTATION(#793,$,$,(#923));
#932= IFCMATERIALDEFINITIONREPRESENTATION($,$,(#927),#790);
#934= IFCMATERIALLAYER(#790,0.3,.U.);
#936= IFCMATERIALLAYERSET((#934),'Leichtbeton');
#938= IFCMATERIALLAYERSETUSAGE(#936,.AXIS2.,.NEGATIVE.,0.);
#939= IFCAXIS2PLACEMENT3D(#56,#52,#48);
#942= IFCLOCALPLACEMENT(#777,#939);
#945= IFCWALLSTANDARDCASE('3rPX_Juz59peXXY6wDJl18',#29,'Wand-Ext-ERDG-1',$,$,#942,#1016,'BEF1E630-DE4B-41C5-AD-66-B87F1A8D67A1');
#964= IFCCARTESIANPOINT((0.,0.));
#968= IFCCARTESIANPOINT((10.,-9.8607613E-32));
#972= IFCPOLYLINE((#964,#968));
#976= IFCSHAPEREPRESENTATION(#229,'Axis','Curve2D',(#972));
#982= IFCCARTESIANPOINT((0.3,-0.3));
#986= IFCCARTESIANPOINT((9.7,-0.3));
#990= IFCCARTESIANPOINT((10.,-9.8607613E-32));
#994= IFCCARTESIANPOINT((1.4791142E-32,2.2204460E-16));
#998= IFCPOLYLINE((#982,#986,#990,#994,#982));
#1002= IFCARBITRARYCLOSEDPROFILEDEF(.AREA.,$,#998);
#1003= IFCAXIS2PLACEMENT3D(#56,#52,#44);
#1007= IFCEXTRUDEDAREASOLID(#1002,#1003,#52,2.7);
#1010= IFCSHAPEREPRESENTATION(#67,'Body','SweptSolid',(#1007));
#1016= IFCPRODUCTDEFINITIONSHAPE($,$,(#976,#1010));
#1020= IFCRELASSOCIATESMATERIAL('29yZtBGnj0b9Ho83CjWxFl',#29,$,$,(#945),#938);
#1022= IFCDIRECTION((-1.,0.));
#1026= IFCCARTESIANPOINT((0.,1.005));
#1030= IFCAXIS2PLACEMENT2D(#1026,#1022);
#1033= IFCRECTANGLEPROFILEDEF(.AREA.,$,#1030,1.01,2.01);
#1034= IFCDIRECTION((-1.,0.,0.));
#1038= IFCAXIS2PLACEMENT3D(#56,#48,#1034);
#1041= IFCEXTRUDEDAREASOLID(#1033,#1038,#52,0.3);
#1044= IFCSHAPEREPRESENTATION(#229,'Body','SweptSolid',(#1041));
#1050= IFCPRODUCTDEFINITIONSHAPE($,$,(#1044));
#1054= IFCCARTESIANPOINT((5.,-0.3,0.));
#1058= IFCAXIS2PLACEMENT3D(#1054,#52,#44);
#1061= IFCLOCALPLACEMENT(#942,#1058);
#1064= IFCOPENINGELEMENT('2m8XZLRu1AmRELZ8mLCMm0',#29,$,$,'Opening',#1061,#1050,'3CAFB746-2204-4C6C-BF-ED-F5FE276FA162');
#1085= IFCRELVOIDSELEMENT('1EUsAZxiz0rOQD_2IyvaUz',#29,$,$,#945,#1064);
#1086= IFCDIRECTION((-1.,0.,0.));
#1090= IFCCARTESIANPOINT((0.505,0.1,0.));
#1094= IFCAXIS2PLACEMENT3D(#1090,#52,#1086);
#1097= IFCLOCALPLACEMENT(#1061,#1094);
#1100= IFCCARTESIANPOINT((1.01,0.1,-3.7866433E-33));
#1104= IFCCARTESIANPOINT((1.01,0.02,-4.8984254E-18));
#1108= IFCCARTESIANPOINT((0.99,0.02,-4.8984254E-18));
#1112= IFCCARTESIANPOINT((0.99,0.1,-3.6366773E-33));
#1116= IFCCARTESIANPOINT((1.01,0.1,2.01));
#1120= IFCCARTESIANPOINT((1.01,0.02,2.01));
#1124= IFCCARTESIANPOINT((0.,0.02,2.01));
#1128= IFCCARTESIANPOINT((0.,0.02,-4.8984254E-18));
#1132= IFCCARTESIANPOINT((0.02,0.02,-4.8984254E-18));
#1137= IFCCARTESIANPOINT((0.02,0.02,1.99));
#1141= IFCCARTESIANPOINT((0.99,0.02,1.99));
#1145= IFCCARTESIANPOINT((0.99,0.1,1.99));
#1149= IFCCARTESIANPOINT((0.02,0.1,1.99));
#1153= IFCCARTESIANPOINT((0.02,0.1,3.6366773E-33));
#1157= IFCCARTESIANPOINT((0.,0.1,3.7866433E-33));
#1161= IFCCARTESIANPOINT((0.,0.1,2.01));
#1165= IFCCARTESIANPOINT((1.01,0.02,-4.8984254E-18));
#1169= IFCCARTESIANPOINT((1.01,9.1593400E-16,-6.1230318E-18));
#1173= IFCCARTESIANPOINT((0.96,9.1593400E-16,-6.1230318E-18));
#1177= IFCCARTESIANPOINT((0.96,0.02,-4.8984254E-18));
#1181= IFCCARTESIANPOINT((1.01,0.02,2.01));
#1185= IFCCARTESIANPOINT((1.01,7.7715612E-16,2.01));
#1189= IFCCARTESIANPOINT((0.,9.7144515E-16,2.01));
#1193= IFCCARTESIANPOINT((0.05,1.0824674E-15,-6.1230318E-18));
#1197= IFCCARTESIANPOINT((0.05,9.7144515E-16,1.96));
#1201= IFCCARTESIANPOINT((0.96,8.0491169E-16,1.96));
#1205= IFCCARTESIANPOINT((0.96,0.02,1.96));
#1209= IFCCARTESIANPOINT((0.05,0.02,1.96));
#1213= IFCCARTESIANPOINT((0.05,0.02,-4.8984254E-18));
#1217= IFCCARTESIANPOINT((0.,0.02,-4.8984254E-18));
#1221= IFCCARTESIANPOINT((0.,0.02,2.01));
#1225= IFCCARTESIANPOINT((0.99,0.1,-3.6366773E-33));
#1229= IFCCARTESIANPOINT((0.99,0.085,-9.1845477E-19));
#1233= IFCCARTESIANPOINT((0.02,0.085,-9.1845477E-19));
#1237= IFCCARTESIANPOINT((0.02,0.1,3.6366773E-33));
#1241= IFCCARTESIANPOINT((0.99,0.1,0.01));
#1245= IFCCARTESIANPOINT((0.99,0.085,0.01));
#1249= IFCCARTESIANPOINT((0.02,0.085,0.01));
#1253= IFCCARTESIANPOINT((0.02,0.1,0.01));
#1257= IFCCARTESIANPOINT((0.99,0.085,-9.1845477E-19));
#1262= IFCCARTESIANPOINT((0.99,0.05,-3.0615159E-18));
#1266= IFCCARTESIANPOINT((0.02,0.05,-3.0615159E-18));
#1270= IFCCARTESIANPOINT((0.02,0.085,-9.1845477E-19));
#1274= IFCCARTESIANPOINT((0.99,0.085,0.01));
#1278= IFCCARTESIANPOINT((0.99,0.05,0.01));
#1282= IFCCARTESIANPOINT((0.02,0.05,0.01));
#1286= IFCCARTESIANPOINT((0.02,0.085,0.01));
#1290= IFCCARTESIANPOINT((0.96,0.05,-3.0615159E-18));
#1294= IFCCARTESIANPOINT((0.96,0.015,-5.2045770E-18));
#1298= IFCCARTESIANPOINT((0.05,0.015,-5.2045770E-18));
#1302= IFCCARTESIANPOINT((0.05,0.05,-3.0615159E-18));
#1306= IFCCARTESIANPOINT((0.96,0.05,0.01));
#1310= IFCCARTESIANPOINT((0.96,0.015,0.01));
#1314= IFCCARTESIANPOINT((0.05,0.015,0.01));
#1318= IFCCARTESIANPOINT((0.05,0.05,0.01));
#1322= IFCCARTESIANPOINT((0.96,0.015,-5.2045770E-18));
#1326= IFCCARTESIANPOINT((0.96,9.1593400E-16,-6.1230318E-18));
#1330= IFCCARTESIANPOINT((0.05,1.0824674E-15,-6.1230318E-18));
#1334= IFCCARTESIANPOINT((0.05,0.015,-5.2045770E-18));
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""")

# ----
# initial validation againtst the schema is
#  not important as this will happen as the
#  individual objects are created.
ifcschemareader = IfcSchema()  # -> out, IFCTypes, IFCEntities, IFCAttributes, IFCFunctions, IFCRules
# ---------- ifcschemareader: Python ----------
import re, copy

class IfcSchema:
    SIMPLETYPES = ["INTEGER", "REAL", "STRING", "NUMBER", "LOGICAL", "BOOLEAN"]
    NO_ATTR = ["WHERE", "INVERSE","WR2","WR3", "WR4", "WR5", "UNIQUE", "DERIVE"]

    def __init__(self, filename):
        self.filename = filename
        self.file = open(self.filename)
        self.data = self.file.read()
        self.types = self.readTypes()
        self.entities = self.readEntities()
        self.functions =  self.readFunctions()
        self.rules =  self.readRules()
        for e in self.entities:
            self.getAttibutes = self.getAttributes(e)
        print "Parsed from schema %s: %s entities and %s types" % (self.filename, len(self.entities), len(self.types))

    def readFunctions(self):
        """
        Parse all the possible functions from the schema, 
        returns a dictionary Name -> Function
        """
        functions = {}
        for m in re.finditer("FUNCTION ((Ifc.*){1}(.*\n)*)?END_FUNCTION;", self.data):
            function = {}
            raw_function_str = m.groups()[0]
            function["name"] = re.search("(.*?)[;|\s]", raw_function_str).groups()[0]
            functions[function["name"]] = function
        return functions

    def readRules(self):
        """
        Parse all the possible rules from the schema, 
        returns a dictionary Name -> Rule
        """
        rules = {}
        for m in re.finditer("RULE ((Ifc.*){1}(.*\n)*)?END_RULE;", self.data):
            rule = {}
            raw_rule_str = m.groups()[0]
            rule["name"] = re.search("(.*?)[;|\s]", raw_rule_str).groups()[0]
            rules[rule["name"]] = rule
        return rules


    def readTypes(self):
        """
        Parse all the possible types from the schema, 
        returns a dictionary Name -> Type
        """
        types = {}
        for m in re.finditer("TYPE (.*) = (.*);", self.data):
            typename, typetype = m.groups() 
            if typetype in self.SIMPLETYPES:
                types[typename] = typetype
            else:
                types[typename] = "#" + typetype
                
        return types
        
    def readEntities(self):
        """
        Parse all the possible entities from the schema,
        returns a dictionary of the form:
        { name: { 
            "supertype": supertype, 
            "attributes": [{ key: value }, ..]
        }}  
        """
        entities = {}
        
        # Regexes must be greedy to prevent matching outer entity and end_entity strings
        # Regexes have re.DOTALL to match newlines
        for m in re.finditer("ENTITY (.*?)END_ENTITY;", self.data, re.DOTALL):
            entity = {}
            raw_entity_str = m.groups()[0]

            entity["name"] = re.search("(.*?)[;|\s]", raw_entity_str).groups()[0].upper()

            subtypeofmatch = re.search(".*SUBTYPE OF \((.*?)\);", raw_entity_str)
            entity["supertype"] = subtypeofmatch.groups()[0].upper() if subtypeofmatch else None

            # find the shortest string matched from the end of the entity type header to the
            # first occurence of a NO_ATTR string (when it occurs on a new line)
            inner_str = re.search(";(.*?)$", raw_entity_str, re.DOTALL).groups()[0]            

            attrs_str = min([inner_str.partition("\r\n "+a)[0] for a in self.NO_ATTR])
            attrs = []
            for am in re.finditer("(.*?) : (.*?);", attrs_str, re.DOTALL):
                name, attr_type = [s.replace("\r\n\t","") for s in am.groups()]
                attrs.append((name, attr_type))
            
            entity["attributes"] = attrs
            entities[entity["name"]] = entity
        

        return entities

    def getAttributes(self, name):
        """
        Get all attributes af an entity, including supertypes
        """
        ent = self.entities[name]

        attrs = []
        while ent != None:
            this_ent_attrs = copy.copy(ent["attributes"])
            this_ent_attrs.reverse()
            attrs.extend(this_ent_attrs)
            ent = self.entities.get(ent["supertype"], None)

        attrs.reverse()
        return attrs
        

if __name__ == "__main__":
    print SchemaPath
    if SchemaPath == None:
        SchemaPath = "C:\xampp\htdocs\IFCParser\IFC2X3_TC1.exp"
    schema = IfcSchema(SchemaPath)
    IFCTypes = schema.types
    IFCEntities = schema.entities
    IFCAttributes = schema.getAttibutes
    IFCFunctions = schema.functions  
    IFCRules = schema.rules
# ---------- end ifcschemareader ----------

# ----
# refined code -
# restructured code from scratch.
# parser
ifcparser = PythonScript(ifc=raw_ifc_2)  # -> out, id, obj, attr, attrcomp, bool, num, type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
# ---------- ifcparser: Python ----------
import re
import rhinoscriptsyntax as rs
import Grasshopper.Kernel as gh

id=[]
obj=[]
attr=[]
ref=[]
nil=[]
txt=[]
type=[]
num=[]
bool=[]
pt=[]
vc=[]
col=[]
regex = r"(#\d+)\s*=\s*([Ii][Ff][Cc]\w+)\s*(\(.*\);)"
if re.search(regex, ifc):
    
    match = re.search(regex, ifc)
    print "line: "+match.group(0).strip()
    print "id: >"+match.group(1).strip()
    print "obj: "+match.group(2).strip()
    print "attr: "+match.group(3).strip()
    id.append(match.group(1).strip())
    obj.append(match.group(2).strip())
    attr.append(match.group(3).strip())
    attr2=[]
    attrcomp = "".join(attr).split(',')
    lvl = 0
    for a in attrcomp:
        """replaces opening brackets,
        replaces end of line bracket,
        replaces closing brackets,
        replaces text closures
        cleans whitespace"""
        at=a.replace(");","").replace(")","").strip()
        if re.search("#", at):
            ref.append(at.replace("(",""))
        if re.search("\$", at):
            nil.append(at.replace("(",""))
        if re.search("^-?\d+(,\d\d\d)*(\.\d*?(E-?\d+)?)?$", at.replace("(","")):
            num.append(float(at.replace("(","")))
        if re.search("\.[TF]\.", at):
            bool.append(at.replace(".T.","True").replace(".F.","False"))
        if re.search("\.[A-Z]{2,}\.", at):
            type.append(at.replace("(",""))
        if re.search("([I][F][C][A-Z]+?)\((.*)", at):
            matcha = re.search("([I][F][C][A-Z]+?)\((.*)", at)
            type.append(matcha.group(1))
            type.append(matcha.group(2))
        if re.search("\'", at.replace("(","")):
            txt.append(at.replace("'","").replace("(",""))
        at=at.replace("'","").replace("(","")
        attr2.append(at)
        
    attrcomp = attr2

    """clears the temporary information holder"""
    attr2=[]
    
    if obj[0] == "IFCCARTESIANPOINT":
        if len(num) == 3:
            pt.append(rs.AddPoint(num[0],num[1],num[2]))
        if len(num) == 2:
            pt.append(rs.AddPoint(num[0],num[1],0))
        else:
            print"invalid point"
    if obj[0] == "IFCDIRECTION":
        if len(num) == 3:
            vc.append(rs.AddPoint(num[0],num[1],num[2]))
        if len(num) == 2:
            vc.append(rs.AddPoint(num[0],num[1],0))
        else:
            print"invalid vector"
    if obj[0] == "IFCCOLOURRGB":
        if len(num) == 3:
            col.append(rs.AddPoint(num[0],num[1],num[2]))
        if len(num) == 4:
            col.append(rs.AddPoint(num[0],num[1],num[2],num[3]))
        else:
            print"invalid vector"
else:
    print(ifc)
# ---------- end ifcparser ----------
# initial code - first attempt based on MVEARLE
ifcparser_2 = IfcParser(ifc=raw_ifc)  # -> simplify(graft(id)), simplify(graft(ifcobj)), ifcpolyloop_2, ifccartesianpoint_2, ifcrgbcolour_2, ifcface_2, ifcface_assrf_2, ifcclosedshell_2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
# object creator
objconversion = ObjConversion(pt=ifcparser.pt, vec=ifcparser.vc, col=ifcparser.col)  # -> pt_3, vec_3, col_3
clean = CleanTree(
    RemoveNulls=True,
    RemoveInvalid=True,
    RemoveEmpty=False,
    Tree=[ifcparser_2.ifcpolyloop_2, ifcparser_2.ifccartesianpoint_2, ifcparser_2.ifcrgbcolour_2, ifcparser_2.ifcface_2, ifcparser_2.ifcface_assrf_2, ifcparser_2.ifcclosedshell_2, ifcparser_2.ifcfacetedbrep_2, ifcparser_2.ifcsurfacestylerenderingwithname_2, ifcparser_2.ifcsurfacestylerendering_2, ifcparser_2.ifcsurfacestyle_2, ifcparser_2.ifcpresentationstyleassignment_4])
brep = Brep(flatten(clean))
col = Colour(ifcparser_2.ifcpresentationstyleassignment_4)

# ----
# display filter
knob = ControlKnob(Decimals=0, Limit=True, Maximum=1010, Minimum=0, Range=103, Value=80)
parsed_ifcobjects = Panel([ifcparser.id, ifcparser.obj, ifcparser.attr])
int = Integer(knob)
int_2 = Integer(0)
path = ConstructPath(Indices=[int_2, int])
branch = TreeBranch(Tree=ifcparser.obj, Path=path, MaintainPaths=True)
panel = Panel(branch)
legend = Legend(Colour=flatten(objconversion.col_3), Tags="colours", LegendType=1)

clean_2 = CleanTree(RemoveNulls=True, RemoveInvalid=True, RemoveEmpty=True, Tree=flatten(brep))  # -> flatten(Tree)
item = CherryPicker(col, ListIndex=6, TreePath_path="{34}")
item_2 = CherryPicker(clean_2, ListIndex=29, TreePath_path="{0}")
preview = CustomPreview(Geometry=item_2, Shader=item)
parsed_ifcobjects_2 = Panel([ifcparser_2.ifcobj, ifcparser_2.id, clean])

# ==== cluster IfcParser
ifc = ClusterInput()
ifcparser = PythonScript(ifc=ifc)  # -> out, id, IfcObj, attr, ref, pt, lineVertices, mesh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
# ---------- ifcparser: Python ----------
import rhinoscriptsyntax as rs
import Grasshopper.Kernel.Data as ghp

""" REGEX Logic Example
(   ) );
(, test );
( (  ), 'test' , test );
( ('test'), 'test , 14 );
('test' , 14 , (test , test) , (test) ,$ ,$ ,* );
($, 'test', $ ,$ ( (23, 12) , 23) 14 14 , ,14, 'test' , (23),23,25,25, 'test); 
(14, 15, 16, 17);

[\(]{1}([. ]*?[^\)][,]*?)*?[\(]{1}				Matches everything up until the first nested bracket 
[\)]([^\(]*?)\);								Matches everything between the last nested bracket and the end
[\)]{1}([^\)\(;]*?)[\(]/g						Matches everything between the ) brackets( on the first level of nesting 
[\(]{1}([^\)\(]*)\);{1}							Matches everything when there are no nested brakets 
"""

testSting = '#1 = IFCOBJ (("arry"),13,14,15,(16,17));'
print(">"+testSting)
print("1>"+testSting.rsplit("=")[0].strip())
print("2>"+testSting.rsplit("=")[1])
print("3>"+testSting.rsplit("=")[1].split('(', 1)[0].replace(");","").strip()) 
print("4>"+testSting.rsplit("=")[1].split('(', 1)[1].replace(");",""))
print("5>"+testSting.rsplit("=")[1].split('(', 1)[1].replace(");","").split(',', 1)[1])



"""standard first pass parse into id and ifcobj"""
id = ifc.rsplit("=")
IfcObj = id[1].rsplit("(")

attrB = id[1].split('(', 1)[1].replace(");","")
print(attrB)
attrC = attrB.rsplit(",")


print(attrC)
"""attribute parse using comma separator"""
attr = IfcObj[1:]
attr = "".join(attr)
print attr
attr = attr.rsplit(",")

"""return id and ifcObject"""
id = id[0].lstrip()

""" initialises a list of #id references found within attributes """
ref = [];
def ListRef():
    for att in attr:
        if ("#" in str(att)):
            ref.append (att)
    print(IfcObj +" has " + str(len( attr )) + " attributes")
    print("and has " + str(len( ref )) + " references")


IfcObj = IfcObj[0].lstrip()

if IfcObj=="IFCCARTESIANPOINT":
    """return x y z of attributes for ifcCartesianPoint attributes """
    x = float(attr[0].rsplit(")")[0].lstrip())
    y = float(attr[1].rsplit(")")[0].lstrip())
    z = float(attr[2].rsplit(")")[0].lstrip())
    attr=[x,y,z]
    pt=rs.AddPoint(x,y,z)
    
    ListRef();


if IfcObj=="IFCPOLYLOOP":
    """return pts references of attributes for ifcPolyLoop attributes """
    A = attr[0].rsplit(")")[0].lstrip()
    B = attr[1].rsplit(")")[0].lstrip()
    C = attr[2].rsplit(")")[0].lstrip()
    if len(attr)==3:
        refIndex = [A,B,C]
        attr=[A,B,C]
    if len(attr)==4:
        D = attr[3].rsplit(")")[0].lstrip()
        refIndex = [A,B,C,D]
        attr=[A,B,C,D]
    lineVertices = refIndex
    ListRef();

if IfcObj=="IFCFACE":
    """return pts references of attributes for ifcPolyLoop attributes """
    F = attr[0].replace(")","").replace("(","").replace(";","").lstrip()
    attr = [F]
    refIndex = F
    mesh = refIndex
    ListRef();

if IfcObj=="IFCFACEOUTERBOUND":
    """return pts references of attributes for ifcPolyLoop attributes """
    F = attr[0].rsplit(")")[0].lstrip()
    G = attr[1].replace(");","").replace(".T.","True").replace(".F.","False").lstrip()
    mesh = [F,G]
    attr = [F,G]
    ListRef();

if IfcObj=="IFCCOLOURRGB":
    """return pts references of attributes for ifcPolyLoop attributes """
    name = attr[0].rsplit(")")[0].replace("'","").lstrip()
    r = int(float(attr[1].rsplit(")")[0].lstrip())*255)
    g = int(float(attr[2].rsplit(")")[0].lstrip())*255)
    b = int(float(attr[3].rsplit(")")[0].lstrip())*255)
    colour = "{"+str(r)+","+str(g)+","+str(b)+"}"
    attr = [name,r,g,b]
    ListRef();

if IfcObj=="IFCCLOSEDSHELL":
    """return list of faces that make up a closed mesh object"""
    solid = ",".join(attr).replace("));", "").rsplit(",")
    attr = solid
    ListRef();

if IfcObj=="IFCFACETEDBREP":
    """return list of BREPs"""
    solid = ",".join(attr).replace(");", "")
    attr = solid.rsplit(",")
    ListRef();

if IfcObj=="IFCSURFACESTYLERENDERING":
    colour = attr[0]
    Ka = attr[1].replace("IFCNORMALISEDRATIOMEASURE","").replace(")","").replace("$","0.5")
    Kd = attr[2].replace("IFCNORMALISEDRATIOMEASURE","").replace(")","").replace("$","0.5")
    Kt = attr[3].replace("IFCNORMALISEDRATIOMEASURE","").replace(")","").replace("$","0.5")
    Kdt = attr[4].replace("IFCNORMALISEDRATIOMEASURE","").replace(")","").replace("$","0.5")
    KR = attr[5].replace("IFCNORMALISEDRATIOMEASURE","").replace(")","").replace("$","{0,0,0}")
    Ks = attr[6].replace("IFCNORMALISEDRATIOMEASURE","").replace(")","").replace("$","0.5")
    Ksh = attr[7].replace("IFCNORMALISEDRATIOMEASURE","").replace(")","").replace("$","{255,255,255}")
    KRm = attr[8].replace("IFCNORMALISEDRATIOMEASURE","").replace(");","").replace(".NOTDEFINED.",".LAMBERT.")
    attr = [colour,Ka,Kd,Kt,Kdt,KR,Ks,Ksh,KRm]
    shader = attr
    ListRef();

if IfcObj=="IFCSURFACESTYLE":
    name = attr[0].replace("'", "")
    Ksided = attr[1]
    K = attr[2].replace("));", "")
    attr = [name,Ksided,K]
    shader = attr
    ListRef();

if IfcObj=="IFCPRESENTATIONSTYLEASSIGNMENT":
    attr = [attr[0].replace("(", "").replace(")", "").replace(";", "")]
    shader = attr
    ListRef();
# ---------- end ifcparser ----------
id = ClusterOutput(ifcparser.id)
ifcobj = ClusterOutput(ifcparser.IfcObj)

mindex = MemberIndex(Set=ifcparser.id, Member=ifcparser.lineVertices)  # -> Index, Count
item = ListItem(List=ifcparser.pt, Index=mindex.Index, Wrap=True)
trim = TrimTree(Tree=item, Depth=1)
point = Point(trim)
pline = PolyLine(Vertices=point, Closed=True)  # -> simplify(IfcPolyLoop)
ifcpolyloop = Curve(simplify(pline))

panel = Panel(ifcparser.attr)

ifcobjfilte = IfcObjFilte(ifcobjs=ifcparser.IfcObj, name=ifcparser.name, ifcobjsearch="ifcColourRGB")  # -> ifcobject, name_3, I
rgb = ColourRGB(Alpha=255, Red=ifcparser.r, Green=ifcparser.g, Blue=ifcparser.b)
ifcrgbcolour = Colour(simplify(graft(rgb)))
data = Data([ifcobjfilte.name_3, ifcrgbcolour])

ifcobjfilte_2 = IfcObjFilte(
    ifcobjs=ifcparser.IfcObj,
    name=ifcparser.name,
    ids=ifcparser.id,
    ifcobjsearch="ifcSurfaceStyleRendering",
    idsearch=ifcparser.colour)  # -> ifcobject, name_3, I
path = ConstructPath(Indices=ifcobjfilte_2.I)
clean = CleanTree(RemoveNulls=True, RemoveInvalid=True, RemoveEmpty=True, Tree=path)
branch = TreeBranch(IfcRGBcolour=data, Path=path, MaintainPaths=True)

col = Colour(branch)
name = Text(branch)
tstat = TreeStatistics(Tree=clean)  # -> Paths, Length, Count
tstat_2 = TreeStatistics(Tree=branch)  # -> Paths, Length, Count

pt = ConstructPoint(XCoordinate=ifcparser.x, YCoordinate=ifcparser.y, ZCoordinate=ifcparser.z)
ifccartesianpoint = Point(simplify(graft(pt)))

replace = ReplacePaths(Data=name, Search=tstat_2.Paths, Replace=flatten(tstat.Paths))
ifcrgbcolour_2 = ClusterOutput(ifcrgbcolour)
ifccartesianpoint_2 = ClusterOutput(ifccartesianpoint)
ifcpolyloop_2 = ClusterOutput(ifcpolyloop)
panel_2 = Panel(data)
ifccartesianpoint_3 = Panel(ifccartesianpoint)
ifcrgbcolour_3 = Panel(ifcrgbcolour)
ifcpolyloop_3 = Panel(ifcpolyloop)

ifcobjfilte_3 = IfcObjFilte(ifcobjs=ifcparser.IfcObj, name=ifcparser.name, ifcobjsearch="IfcSurfaceStyle")  # -> ifcobject, name_3, I
mindex_2 = MemberIndex(Set=ifcparser.id, Material=ifcparser.shader)  # -> Index, Count
sided = Text(simplify(graft(ifcparser.Ksided)))
trim_2 = TrimTree(Tree=mindex_2.Index, Depth=1)  # -> simplify(Tree)
path_2 = ConstructPath(Indices=trim_2)
clean_2 = CleanTree(RemoveNulls=True, RemoveInvalid=True, RemoveEmpty=True, Tree=path_2)
tstat_3 = TreeStatistics(Tree=clean_2)  # -> Paths, Length, Count

ifcobjfilte_4 = IfcObjFilte(ifcobjs=ifcparser.IfcObj, name=ifcparser.name, ifcobjsearch="IfcPresentationStyleAssignment")  # -> ifcobject, name_3, I
mindex_3 = MemberIndex(Set=ifcparser.id, Shader=ifcparser.shader)  # -> Index, Count
trim_3 = TrimTree(Tree=mindex_3.Index, Depth=1)  # -> simplify(Tree)
path_3 = ConstructPath(Indices=trim_3)

clean_3 = CleanTree(RemoveNulls=True, RemoveInvalid=True, RemoveEmpty=True, Tree=path_3)
tstat_4 = TreeStatistics(Tree=clean_3)  # -> Paths, Length, Count

ifcobjfilte_5 = IfcObjFilte(ifcobjs=ifcparser.IfcObj, name=ifcparser.name, ids=ifcparser.id, ifcobjsearch="IfcClosedShell", idsearch=ifcparser.solid)  # -> ifcobject, name_3, graft(I)
clean_4 = CleanTree(RemoveNulls=True, RemoveInvalid=True, RemoveEmpty=True, Tree=ifcobjfilte_5.I)

# ---- group: find index # references
ifcobjfilte_6 = IfcObjFilte(ifcobjs=ifcparser.IfcObj, name=ifcparser.name, ids=ifcparser.id, ifcobjsearch="ifcFacetedBrep", idsearch=ifcparser.solid)  # -> ifcobject, name_3, I

# ----
path_4 = ConstructPath(Indices=ifcobjfilte_6.I)
viewer = ParamViewer(path_4)

# ---- group: find index of # references
ifcobjfilte_7 = IfcObjFilte_2(ifcobjs=ifcparser.IfcObj, name=ifcparser.name, ids=ifcparser.id, ifcobjsearch="ifcFace", idsearch=ifcparser.F)  # -> ifcobject, name_3, I
text = Text(ifcparser.id)
item_2 = TreeItem(Mesh=simplify(ifcparser.mesh), Path=ifcobjfilte_7.I, Index=0, Wrap=True)  # -> simplify(IfcFaceOuterBound)

# ----
ifcobjfilte_8 = IfcObjFilte_2(ifcobjs=ifcparser.IfcObj, name=ifcparser.name, ids=ifcparser.id, ifcobjsearch="ifcFace", idsearch=item_2)  # -> ifcobject, name_3, I

# ---- group: find index of # references (continued)
item_3 = ListItem(IfcPolyLoop=flatten(ifcpolyloop), Index=ifcobjfilte_8.I, Wrap=True)

# ----
clean_5 = CleanTree(RemoveNulls=True, RemoveInvalid=True, RemoveEmpty=True, Tree=item_3)
clean_6 = CleanTree(RemoveNulls=True, RemoveInvalid=True, RemoveEmpty=True, Tree=item_3)

# ---- group: construct IFCFACE AsSrf
ifcface_assrf = Surface(simplify(clean_6))

# ---- group: find index # references
branch_2 = TreeBranch(Tree=ifcface_assrf, Path=ifcobjfilte_5.I, MaintainPaths=True)
trim_4 = Trim(data=branch_2, pathtomatch=clean_4)

# ---- group: find index # references / As Brep
join = BrepJoin(Breps=trim_4)  # -> Breps, Closed
item_4 = ListItem(List=join.Breps, Index=0, Wrap=True)
ifcclosedshell_asbrep = Brep(simplify(item_4))

# ---- group: find index # references (continued)
branch_3 = TreeBranch(Tree=ifcclosedshell_asbrep, Path=path_4, MaintainPaths=True)

# ----
ifcfacetedbrep = Brep(simplify(branch_3))

# ---- group: find index of # references / construct IFCFACE
ifcface = Mesh(simplify(clean_5))

# ----
branch_4 = TreeBranch(Tree=ifcface, Path=ifcobjfilte_5.I, MaintainPaths=True)
trim_5 = Trim(data=branch_4, pathtomatch=clean_4)

# ---- group: As Mesh
mjoin = MeshJoin(Meshes=trim_5)  # -> simplify(IfcClosedShell)
ifcclosedshell = Mesh(simplify(mjoin))

# ----
ifcface_2 = ClusterOutput(ifcface)
ifcface_assrf_2 = ClusterOutput(ifcface_assrf)
ifcclosedshell_2 = ClusterOutput(ifcclosedshell)
ifcfacetedbrep_2 = ClusterOutput(ifcfacetedbrep)
ifcpresentationstyleassignment = Panel(ifcfacetedbrep)
ifcface_3 = Panel(ifcface)

# ---- group: constructShader
material = CreateMaterial(Diffuse=col, Specular=ifcparser.Ksh, Emission=ifcparser.KR, Transparency=ifcparser.Ka, Shine=ifcparser.Ks)  # -> simplify(graft(Material))
ifcsurfacestylerendering = Shader(material)

# ----
ifcsurfacestylerendering_2 = ClusterOutput(ifcsurfacestylerendering)
clean_7 = CleanTree(RemoveNulls=True, RemoveInvalid=True, RemoveEmpty=True, Tree=[replace, ifcsurfacestylerendering])

# ---- group: constructShader (continued)
ifcsurfacestylerenderingwithname = Data(simplify(clean_7))

# ----
ifcsurfacestylerenderingwithname_2 = ClusterOutput(ifcsurfacestylerenderingwithname)
ifcpresentationstyleassignment_2 = Panel(ifcsurfacestylerenderingwithname)

branch_5 = TreeBranch(Tree=ifcsurfacestylerenderingwithname, Path=path_2, MaintainPaths=True)
tstat_5 = TreeStatistics(Tree=branch_5)  # -> Paths, Length, Count
replace_2 = ReplacePaths(Data=branch_5, Search=tstat_5.Paths, Replace=flatten(tstat_3.Paths))

clean_8 = CleanTree(RemoveNulls=True, RemoveInvalid=True, RemoveEmpty=True, Tree=[ifcobjfilte_3.name_3, sided, replace_2])

ifcsurfacestyle = Data(simplify(clean_8))

ifcsurfacestyle_2 = ClusterOutput(ifcsurfacestyle)
ifcsurfacestyle_3 = Panel(ifcsurfacestyle)

branch_6 = TreeBranch(Tree=ifcsurfacestyle, Path=path_3, MaintainPaths=True)

tstat_6 = TreeStatistics(Tree=branch_6)  # -> Paths, Length, Count
replace_3 = ReplacePaths(Data=branch_6, Search=tstat_6.Paths, Replace=flatten(tstat_4.Paths))
clean_9 = CleanTree(RemoveNulls=True, RemoveInvalid=True, RemoveEmpty=True, Tree=replace_3)

ifcpresentationstyleassignment_3 = Data(simplify(clean_9))

ifcpresentationstyleassignment_4 = ClusterOutput(ifcpresentationstyleassignment_3)
ifcpresentationstyleassignment_5 = Panel(ifcpresentationstyleassignment_3)

# ==== cluster ObjConversion
col = ClusterInput()
pdecon = Deconstruct(Point=col)  # -> XComponent, YComponent, ZComponent
pt = ClusterInput()
vec = ClusterInput()
frgb = ColourRGBF(Alpha=1, Red=pdecon.XComponent, Green=pdecon.YComponent, Blue=pdecon.ZComponent)
pt_2 = Point(pt)
vec_2 = Vector(vec)
col_2 = Colour(frgb)
pt_3 = ClusterOutput(pt_2)
vec_3 = ClusterOutput(vec_2)
col_3 = ClusterOutput(col_2)
points = PointList(Points=flatten(pt_2))
vdis = VectorDisplay(Anchor=Point(0, 0, 0), Vector=vec_2)

# ==== cluster IfcObjFilte
ifcobjsearch = ClusterInput()
idsearch = ClusterInput()
ids = ClusterInput()
ifcobjs = ClusterInput()
name = ClusterInput()
case = TextCase(IfcObjSearch=ifcobjsearch, Culture=127)  # -> UpperCase, LowerCase
ifcobjs_2 = Text(simplify(graft(ifcobjs)))
name_2 = Text(simplify(graft(name)))
mindex = MemberIndex(Ids=ids, IdSearch=idsearch)  # -> Index, Count
tmatch = MatchText(IfcObjs=simplify(ifcobjs_2), Pattern=case.UpperCase, Case=True)
trim = TrimTree(Tree=mindex.Index, Depth=1)  # -> simplify(Tree)
cull = CullPattern(List=ifcobjs_2, CullPattern=tmatch)
cull_2 = CullPattern(List=name_2, CullPattern=tmatch)
clean = CleanTree(RemoveNulls=True, RemoveInvalid=True, RemoveEmpty=True, Tree=cull)
clean_2 = CleanTree(RemoveNulls=True, RemoveInvalid=True, RemoveEmpty=True, Tree=cull_2)
cull_3 = CullPattern(List=trim, CullPattern=tmatch)
name_3 = ClusterOutput(clean_2)
ifcobject = ClusterOutput(clean)
I = ClusterOutput(cull_3)
panel = Panel(mindex.Index)

# ==== cluster IfcObjFilte_2
ifcobjsearch = ClusterInput()
idsearch = ClusterInput()
ids = ClusterInput()
ifcobjs = ClusterInput()
name = ClusterInput()
case = TextCase(IfcObjSearch=ifcobjsearch, Culture=127)  # -> UpperCase, LowerCase
ifcobjs_2 = Text(simplify(graft(ifcobjs)))
name_2 = Text(simplify(graft(name)))
mindex = MemberIndex(Ids=ids, IdSearch=idsearch)  # -> simplify(Index), Count
tmatch = MatchText(IfcObjs=simplify(ifcobjs_2), Pattern=case.UpperCase, Case=True)
cull = CullPattern(List=ifcobjs_2, CullPattern=tmatch)
cull_2 = CullPattern(List=name_2, CullPattern=tmatch)
clean = CleanTree(RemoveNulls=True, RemoveInvalid=True, RemoveEmpty=True, Tree=cull)
clean_2 = CleanTree(RemoveNulls=True, RemoveInvalid=True, RemoveEmpty=True, Tree=cull_2)
cull_3 = CullPattern(List=mindex.Index, CullPattern=tmatch)
name_3 = ClusterOutput(clean_2)
ifcobject = ClusterOutput(clean)
I = ClusterOutput(cull_3)
panel = Panel(mindex.Index)

# ==== cluster Trim
pathtomatch = ClusterInput()
tstat = TreeStatistics(PathToMatch=pathtomatch)  # -> Paths, Length, Count
data = ClusterInput()
dpath = DeconstructPath(Branch=tstat.Paths)
data_2 = Data(data)
tstat_2 = TreeStatistics(Tree=data_2)  # -> Paths, Length, Count
item = ListItem(List=dpath, Index=0, Wrap=True)
replace = ReplacePaths(Data=data_2, Search=tstat_2.Paths, Replace=flatten(item))
D = ClusterOutput(replace)
